# Grasshopper definition main.gh (Grasshopper 1.0.7)

crv = Curve(<curve referenced from the Rhino model>)
number_slider = Slider(0, range=0..10)
python = GhPythonScript(boundary=crv)  # -> out, segments, voronoi_curves, street_curves, tree_points; inputs boundary: Curve
# ---------- python: Python ----------
import fx

reload(fx)
reload(fx.utils)
reload(fx.tree_new)
from fx.window import draw_window
from fx.tree_new import main
seed_count =5
#draw_window(segments[0])
print(boundary)
voronoi_curves, street_curves, tree_points = main(seed_count,boundary)
# ---------- end python ----------
incurve = PointInCurve()  # -> Relationship, Point
crv_2 = Curve()
